# Grasshopper definition Weave_Slicer_open_source.gh (Grasshopper 1.0.7)

# ---- group: Basic Parameters
period = Slider(2.25, range=0..10)
bottom_layers = Slider(3, range=0..10)
layer_height = Slider(0.9, range=0..5)

# ---- group: Weave slicer parameters / Wall thickness
wall_thickness_amplitude = Slider(3, range=0..10)
wall_angle = Slider(0, range=0..180)

# ---- group: Printer Settings
# Suggested Extrusion Rates
# 
# 3d Potter Super:
# 3mm Nozzle--> 2.0 Extrusion Rate
# 5mm Nozzle--> 3.5 Extrusion Rate
# 
# 3d Potter Micro:
# 3mm Nozzle--> 2.0 Extrusion Rate
# 
# 
# Eazao Zero:
# 1.55mm Nozzle--> 0.7 Extrusion Rate
nozzle_width = Slider(1.55, range=0..10)
extrusion_rate = Slider(0.7, range=0..10)
speed = Slider(1000, range=0..2000)
list = ValueList({"3D Potter Super": 0, "3D Potter Micro": 1, "Eazao": 2, "Lutum": 3}, selected="Eazao")
merge = Merge(Data1=list, Data2=nozzle_width, Data3=layer_height, Data4=extrusion_rate, Data5=speed)

# ---- group: Weave slicer parameters / Oscillations per layer
list_2 = ValueList({"Constant Period": 0, "Constant Oscillations": 1}, selected="Constant Period")

# ---- group: Weave slicer parameters / Wall Angle and Amplitude Framework
list_3 = ValueList({"Fixed Amplitude": 0, "Relative": 1, "Adaptive Width": 2}, selected="Adaptive Width")

# ---- group: Weave slicer parameters / Slice on Surface or Inside Surface
list_4 = ValueList({"On Surface": 0, "Inside Surface": 1}, selected="Inside Surface")

# ---- group: Adjust Start Point (optional)
# These are optional settings
# if you would like to adjust
# where each layer begins.
start = Slider(0, range=0..1)
list_5 = ValueList({"Adjust Seam": 0, "No Adjust Seam": 1}, selected="Adjust Seam")

# ---- group: Optional bottom layers
list_6 = ValueList({"Solid Bottom": 0, "No Bottom": 1}, selected="No Bottom")

# ---- group: Right click and Set one Geometry in Rhino
# Set a 3D model in Rhino
# and then chose your printer
# and settings.
geo = Geometry()

# ----
merge_2 = Merge(
    Data1=list_6,
    Data2=period,
    Data3=bottom_layers,
    Data4=list_4,
    Data5=list_3,
    Data6=list_2,
    Data7=wall_thickness_amplitude)

# ---- group: Flat Contours and Adjust Seam
pt = ConstructPoint(XCoordinate=0, YCoordinate=0, ZCoordinate=0.01)
contour = Contour(Shape=geo, Point=pt, Direction=Vector(0, 0, 1), Distance=layer_height)  # -> simplify(Contours)
path = ConstructPath(Indices="0")
branch = TreeBranch(Tree=simplify(contour), Path=path, MaintainPaths=True)
flatten = FlattenTree(Tree=contour, Path="{0}")
eval = EvaluateCurve(Curve=reparameterize(branch), Parameter=start)  # -> Point, Tangent, Angle
python = GhPythonScript(curves=flatten, base_start_point=eval.Point)  # -> out, curves; inputs curves: list
# ---------- python: Python ----------
import rhinoscriptsyntax as rs

start = base_start_point
for curve in curves:
    new_start = rs.CurveClosestPoint(curve, start)
    rs.CurveSeam(curve,new_start)
    start = rs.CurveStartPoint(curve)
# ---------- end python ----------
graft = GraftTree(Tree=python.curves, IncludeEmptyLists=True, IncludeNullItems=True)  # -> simplify(Tree)
filter = StreamFilter(Gate=list_5, Stream0=graft, Stream1=contour)
flipclscrv = FlipClosedCurvesSame(relay=filter)

# ---- group: Amplitude Calculation / Slope
horiz_amplitude = Slider(3, range=0..5)
vert_amplitude = Slider(0, range=0..5)
merge_3 = Merge(Data1=horiz_amplitude, Data2=vert_amplitude)

# ---- group: Weave Pattern / Wall tilt options
list_7 = ValueList({"Out-Up In-Down": 0, "Out-Down In-Up": 1, "Down-Out and In": 2, "Down-Middle": 3}, selected="Out-Up In-Down")

# ---- group: Amplitude Calculation / How the wall tilt is determined
list_8 = ValueList({"Slope": 0, "Angle": 1}, selected="Angle")

# ---- group: Weave Pattern / Ocsillation Pattern Horizontal
panel = Panel("""0
1
0
-1""")

# ---- group: Weave Pattern / Shift Pattern Horizontal (Difference between consecutive layers)
panel_2 = Panel("""0
2""")

# ---- group: Amplitude Calculation
expression = Expression(x=wall_angle, Expression="x+90")
filter_2 = StreamFilter(Gate=list_3, Stream0=wall_angle, Stream1=expression, Stream2=wall_angle)
rad = Radians(Degrees=filter_2)
expression_2 = Expression(c=wall_thickness_amplitude, t=rad, Expression="c*Sin(t)")
expression_3 = Expression(c=wall_thickness_amplitude, t=rad, Expression="c*Cos(t)")
merge_4 = Merge(Data1=expression_3, Data2=expression_2)

# ---- group: Weave Pattern
num = Number(panel)
expression_4 = Expression(x=num, Expression="If(x=0,-1,0)")
expression_5 = Expression(x=num, Expression="-Abs(x)")
neg = Negative(Value=num)
filter_3 = StreamFilter(Gate=list_7, Stream0=neg, Stream1=num, Stream2=expression_5, Stream3=expression_4)

# ---- group: points
len = Length(Curve=flipclscrv)
listmax = MaxInList(N=flatten(len))
expression_6 = Expression(x=period, Expression="x/4")
lng = ListLength(List=num)
filter_4 = StreamFilter(Gate=list_2, Stream0=len, Stream1=listmax)
expression_7 = Expression(x=filter_4, y=expression_6, n=lng, Expression="n*Round(x/(n*y),0)")
divide = DivideCurve(Curve=flipclscrv, Count=expression_7, Kinks=False)  # -> simplify(Points), Tangents, Parameters
Z = UnitZ(Factor=1)
panel_3 = Panel("Pi/2")

# ---- group: points / normal vectors
vrot = Rotate(Vector=divide.Tangents, Axis=Z, Angle=panel_3)  # -> simplify(Vector)

# ---- group: Amplitude Calculation
filter_5 = StreamFilter(Gate=list_8, Stream0=merge_3, Stream1=merge_4)
dispatch = Dispatch(List=filter_5, DispatchPattern=[True, False])  # -> ListA, ListB

panel_4 = Panel("""{-1}
{0}
{1}""")
relitem = RelativeItem(Tree=flipclscrv, Offset=panel_4, WrapPaths=Toggle(False), WrapItems=False)  # -> ItemA, ItemB
lng_2 = ListLength(List=divide.Points)
graft_2 = GraftTree(Tree=divide.Points, IncludeEmptyLists=True, IncludeNullItems=True)
group = Group(Objects=relitem.ItemB)
repeat = RepeatData(Data=group, Length=lng_2)
graft_3 = GraftTree(Tree=repeat, IncludeEmptyLists=True, IncludeNullItems=True)  # -> simplify(Tree)
ungroup = Ungroup(Group=graft_3)  # -> simplify(Objects)
crv_cp = CurveClosestPoint(Point=graft_2, Curve=ungroup)  # -> Point, Parameter, Distance
intcrv = Interpolate(Vertices=crv_cp.Point, Degree=3, Periodic=False, KnotStyle=1)  # -> Curve, Length, Domain
crv_cp_2 = CurveClosestPoint(Point=graft_2, Curve=intcrv.Curve)  # -> Point, Parameter, Distance
eval_2 = EvaluateCurve(Curve=intcrv.Curve, Parameter=crv_cp_2.Parameter)  # -> Point, Tangent, Angle
neg_2 = Negative(Value=vrot)
pshift = ShiftPaths(Data=eval_2.Tangent, Offset=-1)
angle = Angle(VectorA=neg_2, VectorB=pshift)  # -> Angle, Reflex
num_2 = Number(angle.Angle)
addition = Addition(A=angle.Angle, B=rad)
expression_8 = Expression(n=wall_thickness_amplitude, t=num_2, Expression="n/Sin(t)")
expression_9 = Expression(c=expression_8, t=rad, Expression="c*Cos(t)")
expression_10 = Expression(c=wall_thickness_amplitude, t=addition, Expression="c*Cos(t)")
expression_11 = Expression(c=wall_thickness_amplitude, t=addition, Expression="c*Sin(t)")
expression_12 = Expression(c=expression_8, t=rad, Expression="c*Sin(t)")
filter_6 = StreamFilter(Gate=list_3, Stream0=dispatch.ListA, Stream1=expression_10, Stream2=expression_9)
filter_7 = StreamFilter(Gate=list_3, Stream0=dispatch.ListB, Stream1=expression_11, Stream2=expression_12)

# ---- group: Tool Path Viz
# Use this slider to visualize your toolpath
percentage_to_visualize = Slider(1, range=0..1)

# ---- group: GCode
# Once you change settings,
# click the PLAY button to compile the gcode
python_2 = GhPythonScript()  # -> out, file
# ---------- python_2: Python ----------
# script to generate a file for .gcode

import rhinoscriptsyntax as rs

filter = "GCode (*.gcode)|*.gcode|All Files (*.*)|*.*||"
file = rs.SaveFileName("", filter)
# ---------- end python_2 ----------

# ---- group: organizing patterns
tstat = TreeStatistics(Tree=vrot)  # -> Paths, Length, Count
lng_3 = ListLength(List=tstat.Paths)

# ---- group: organizing patterns / Organizing Horizontal Patterns
repeat_2 = RepeatData(Data=num, Length=expression_7)
multiplication = Multiplication(A=repeat_2, B=filter_6)  # -> simplify(Result)
dup = DuplicateData(Data=multiplication, Number=lng_3, Order=True)
unflatten = UnflattenTree(Tree=dup, Guide=divide.Points)
area = Area(Geometry=flipclscrv)  # -> Area, Centroid
dist = Distance(PointA=divide.Points, PointB=area.Centroid)

# ---- group: organizing patterns (continued)
cluster = Cluster(T=multiplication)
expression_13 = Expression(x=cluster, Expression="If(x=1,0,1)")

# ---- group: organizing patterns / Organizing Vertical Patterns
repeat_3 = RepeatData(Data=filter_3, Length=expression_7)
multiplication_2 = Multiplication(A=repeat_3, B=filter_7)  # -> simplify(Result)
dup_2 = DuplicateData(Data=multiplication_2, Number=lng_3, Order=True)
unflatten_2 = UnflattenTree(Tree=dup_2, Guide=divide.Points)
filter_8 = StreamFilter(Gate=expression_13, Stream0=unflatten_2, Stream1=multiplication_2)

# ---- group: organizing patterns / Organizing Horizontal Patterns (continued)
filter_9 = StreamFilter(Gate=expression_13, Stream0=unflatten, Stream1=multiplication)
addition_2 = Addition(A=filter_9, B=filter_6)
expression_14 = Expression(x=addition_2, Expression="If(x<0, -1, If(x=0, 0, 1))")
expression_15 = Expression(x=addition_2, y=dist, z=expression_14, Expression="If(Abs(x)>y, z*(y-.25), x)")
filter_10 = StreamFilter(Gate=list_4, Stream0=filter_9, Stream1=expression_15)

# ---- group: Wall Curves
repeat_4 = RepeatData(Data=panel_2, Length=lng_3)  # -> simplify(graft(Data))
series = Series(Start=0, Step=1, Count=bottom_layers)  # -> simplify(graft(Series))
path_2 = ConstructPath(Indices=series)  # -> simplify(flatten(Branch))
shift = ShiftList(List=divide.Points, Shift=repeat_4, Wrap=True)  # -> simplify(List)
shift_2 = ShiftList(List=vrot, Shift=repeat_4, Wrap=True)  # -> simplify(List)
split = SplitTree(Data=shift, Masks=path_2)  # -> Positive, Negative
split_2 = SplitTree(Data=shift_2, Masks=path_2)  # -> Positive, Negative
split_3 = SplitTree(Data=filter_10, Masks=path_2)  # -> Positive, Negative
split_4 = SplitTree(Data=filter_8, Masks=path_2)  # -> Positive, Negative
multiplication_3 = Multiplication(A=split_2.Positive, B=split_3.Positive)
multiplication_4 = Multiplication(A=split_2.Negative, B=split_3.Negative)
devec = DeconstructVector(Vector=multiplication_4)  # -> XComponent, YComponent, ZComponent
addition_3 = Addition(A=devec.ZComponent, B=split_4.Negative)
vec = VectorXYZ(XComponent=devec.XComponent, YComponent=devec.YComponent, ZComponent=addition_3)  # -> Vector, Length
move = Move(Geometry=split.Positive, Motion=multiplication_3)  # -> Geometry, Transform
move_2 = Move(Geometry=split.Negative, Motion=vec.Vector)  # -> Geometry, Transform
path_mapper = PathMapper(move.Geometry, source="{A}", target="{A;0}")
group_2 = Group(Objects=path_mapper)

# ---- group: solid bottom
series_2 = Series(Start=0, Step=1, Count=bottom_layers)  # -> simplify(graft(Series))
expression_16 = Expression(x=nozzle_width, Expression="2.5*x")
expression_17 = Expression(x=nozzle_width, Expression="x*1.2")
path_3 = ConstructPath(Indices=series_2)  # -> simplify(Branch)
filter_11 = StreamFilter(Gate=list_4, Stream0=nozzle_width, Stream1=expression_16)
branch_2 = TreeBranch(Tree=flipclscrv, Path=path_3, MaintainPaths=True)
area_2 = Area(Geometry=branch_2)  # -> Area, Centroid
crv_cp_3 = CurveClosestPoint(Point=area_2.Centroid, Curve=branch_2)  # -> Point, Parameter, Distance
expression_18 = Expression(x=crv_cp_3.Distance, y=expression_17, Expression="Round(x/y)-1")
expression_19 = Expression(x=crv_cp_3.Distance, y=expression_17, Expression="Round(x/y)")
filter_12 = StreamFilter(Gate=list_4, Stream0=expression_19, Stream1=expression_18)
print_resolution = Slider(1, range=0..5)
expression_20 = Expression(x=bottom_layers, Expression="If(x\2=0, 0,1)")
series_3 = Series(Start=filter_11, Step=expression_17, Count=filter_12)  # -> simplify(Series)
neg_3 = Negative(Value=series_3)
offset = OffsetCurve(Curve=branch_2, Distance=neg_3, Corners=1)  # -> simplify(Curve)
clean = CleanTree(RemoveNulls=True, RemoveInvalid=True, RemoveEmpty=False, Tree=offset)
pshift_2 = ShiftPaths(Data=clean, Offset=-1)  # -> simplify(Data)
len_2 = Length(Curve=pshift_2)
expression_21 = Expression(x=len_2, y=print_resolution, Expression="Round(x/y)")
divide_2 = DivideCurve(Curve=pshift_2, Count=expression_21, Kinks=False)  # -> Points, Tangents, Parameters
path_mapper_2 = PathMapper(divide_2.Points, source="{A;B}", target="{A;B+1}")
group_3 = Group(Objects=path_mapper_2)
merge_5 = Merge(Data1=group_2, Data2=group_3)
pshift_3 = ShiftPaths(Data=merge_5, Offset=-1)
rev = ReverseList(List=pshift_3)
tstat_2 = TreeStatistics(Tree=pshift_3)  # -> Paths, Length, Count
tstat_3 = TreeStatistics(Tree=rev)  # -> Paths, Length, Count
dispatch_2 = Dispatch(List=tstat_2.Paths, DispatchPattern=[True, False])  # -> ListA, ListB
dispatch_3 = Dispatch(List=tstat_3.Paths, DispatchPattern=[True, False])  # -> ListA, ListB
branch_3 = TreeBranch(Tree=pshift_3, Path=dispatch_2.ListA, MaintainPaths=True)
branch_4 = TreeBranch(Tree=pshift_3, Path=dispatch_2.ListB, MaintainPaths=True)
branch_5 = TreeBranch(Tree=rev, Path=dispatch_3.ListA, MaintainPaths=True)
branch_6 = TreeBranch(Tree=rev, Path=dispatch_3.ListB, MaintainPaths=True)
merge_6 = Merge(Data1=branch_3, Data2=branch_6)
merge_7 = Merge(Data1=branch_5, Data2=branch_4)
filter_13 = StreamFilter(Gate=expression_20, Stream0=merge_6, Stream1=merge_7)
ungroup_2 = Ungroup(Group=filter_13)
pshift_4 = ShiftPaths(Data=ungroup_2, Offset=-1)

# ---- group: Point Adjustments
filter_14 = StreamFilter(Gate=list_6, Stream0=pshift_4, Stream1=move.Geometry)
merge_8 = Merge(Data1=filter_14, Data2=move_2.Geometry)
incurve = PointInCurve(Point=merge_8, Curve=flipclscrv)  # -> Relationship, Point
expression_22 = Expression(x=incurve.Relationship, Expression="If(x=0,0,1)")
dispatch_4 = Dispatch(List=merge_8, DispatchPattern=expression_22)  # -> ListA, ListB
pt_2 = Point(dispatch_4.ListB)
crv_cp_4 = CurveClosestPoint(Point=pt_2, Curve=flipclscrv)  # -> Point, Parameter, Distance
weave = Weave(Pattern=expression_22, Stream0=crv_cp_4.Point, Stream1=dispatch_4.ListA, NullGaps=False)
filter_15 = StreamFilter(Gate=list_4, Stream0=merge_8, Stream1=weave)

# ---- group: GCode (continued)
pt_3 = Point(flatten(filter_15))
dam = DataDam(DataA=merge, DataB=merge_2, DataC=pt_3, BufferDelay=10000000, BufferMode=0)  # -> DataA, DataB, DataC
python_3 = GhPythonScript(file=python_2.file, printer_info=dam.DataA, printing_info=dam.DataB, points=dam.DataC)  # -> out, simplify(points), simplify(rates); inputs printer_info: list, printing_info: list, points: list of Point3d
# ---------- python_3: Python ----------
__author__ = "CamilaFG"

import rhinoscriptsyntax as rs
import math
import os


#def initial_comments():
#    return"""; *************** Printer parameters **************
#; Printer: 3Dpotter Super
#; Nozzle size: 3.0
#; Extrude width: 3.5
#; Layer height: 1.5
#; Extrude rate: 3.0
#; Speed: 1000
    
#"""

def set_initial_comments(printer, nozzle_size, layer_height, extrude_rate, speed):
    return"""; *************** Printer parameters **************
; Printer: """ + printer + """
; Nozzle size: """ + str(nozzle_size) + """
; Extrude width: """ + str(float(nozzle_size)*1.2) + """
; Layer height: """ + str(layer_height) + """
; Extrude rate: """ + str(extrude_rate) + """
; Speed: """ + str(speed) + """
    
"""

def set_printing_comments(bottom, period, bot_layers, inside_outside, amp_framework, osc_per_layer, wall_thickness):
    if bottom == 0:
        str_bottom = "Solid Bottom"
    else:
        str_bottom = "No Bottom"
    if inside_outside == 0:
        str_inside_outside = "On Surface"
    else:
        str_inside_outside = "Inside Surface"
    if amp_framework == 0:
        str_amp_framework = "Fixed Amplitude"
    elif amp_framework == 1:
        str_amp_framework = "Relative"
    else:
        str_amp_framework = "Adaptive Width"
    if osc_per_layer == 0:
        str_osc_per_layer = "Constant Period"
    else:
        str_osc_per_layer = "Constant Oscillations"    
    return"""; *************** Printer parameters **************
; Bottom: """ + str_bottom + """
; Period: """ + str(period) + """ mm
; Bottom Layers: """ + str(bot_layers) + """
; Inside or On: """ + str_inside_outside + """
; Amplitude Framework: """ + str_amp_framework + """
; Oscillations per Layer: """ + str_osc_per_layer + """
; Wall thickness: """ + str(wall_thickness) + """
    
"""

def set_preamble(n):
    if n == 0:
        return"""; *************** 3D Potter Super initialization **************
M82                             ; Absolute extrusion mode
G28                             ; Home all axes
G92 E0                          ; Reset Extruder                  
G90 				            ; Absolute coordinates for X,Y,Z 
G1 X202.5 Y202.5 Z25 F1000      ; Go to the starting position (center of bed) 25mm above print
G1 F40000 E2000                 ; Prime Extruder, Extrude 1000mm of clay
M83                             ; Relative extrusion
G1 F1200
; *************** End printer initialization **************
    
"""
    elif n == 1:
        return"""; *************** 3D Potter Micro initialization **************
M82                             ; Absolute extrusion mode
G28                             ; Home all axes
G92 E0                          ; Reset Extruder
G90                             ; Absolute coordinates for X,Y,Z   
G1 X132.0 Y150 Z100 F1000       ; Go to the starting position (center of bed) 25mm above print
G1 F5000 E1000                  ; Prime Extruder, Extrude 1000mm of clay
M83                             ; Relative extrusion
G1 F1000
; *************** End printer initialization **************
    
"""
    elif n == 2:
        return"""; *************** Eazao initialization **************
G21                             ;metric values
G90                             ;absolute positioning
M82                             ;set extruder to absolute mode
G28 X0 Y0                       ;move X/Y to min endstops
G28 Z0                          ;move Z to min endstops
G1 Z15.0 F1500                  ;move the platform down 15mm
G92 E0                          ;zero the extruded length
G1 F2000 E20                    ;extrude 20mm of feed stock
G92 E0                          ;zero the extruded length again
M302
G1 F1000
M83                             ; Relative extrusion
M302 S0                         ; always allow extrusion (disable checking)
M163 S0 P0.92                    ; Set Mix Factor
M163 S1 P0.08                    ; Set Mix Factor
M164 S0
; *************** End printer initialization **************
"""

    elif n == 3:
        return"""; *************** Lutum initialization **************
M107
;TYPE:Custom
G28 ; home all axes


G21 ; set units to millimeters
G90 ; use absolute coordinates
M83 ; use absolute distances for extrusion
G92 E0
; *************** End printer initialization **************
"""
    else:
        return "Invalid Printer"
    
    
def set_preamble_super():
    return"""; *************** 3D Potter initialization **************
M82                             ; Absolute extrusion mode
G28                             ; Home all axes
G92 E0                          ; Reset Extruder                  
G90 				            ; Absolute coordinates for X,Y,Z 
G1 X202.5 Y202.5 Z25 F1000      ; Go to the starting position (center of bed) 25mm above print
G1 F40000 E2000                 ; Prime Extruder, Extrude 1000mm of clay
M83                             ; Relative extrusion
G1 F1200
; *************** End printer initialization **************
    
"""
def set_preamble_micro():
    return"""; *************** 3D Potter initialization **************
M82                             ; Absolute extrusion mode
G28                             ; Home all axes
G92 E0                          ; Reset Extruder
G90                             ; Absolute coordinates for X,Y,Z   
G1 X132.0 Y150 Z100 F1000       ; Go to the starting position (center of bed) 25mm above print
G1 F5000 E1000                  ; Prime Extruder, Extrude 1000mm of clay
M83                             ; Relative extrusion
G1 F1000
; *************** End printer initialization **************
    
"""

def set_preamble_eazao():
    return"""; *************** 3D Potter initialization **************
G21                             ;metric values
G90                             ;absolute positioning
M82                             ;set extruder to absolute mode
G28 X0 Y0                       ;move X/Y to min endstops
G28 Z0                          ;move Z to min endstops
G1 Z15.0 F1500                  ;move the platform down 15mm
G92 E0                          ;zero the extruded length
G1 F200 E3                      ;extrude 3mm of feed stock
G92 E0                          ;zero the extruded length again
M302
G1 F1500
M83                             ; Relative extrusion
M302 S0                         ; always allow extrusion (disable checking)
M163 S0 P0.9                    ; Set Mix Factor
M163 S1 P0.1                    ; Set Mix Factor
M164 S0
; *************** End printer initialization **************
"""

def set_postamble():
    return"""G91                ; Relative coordinates
G1 F5000 Z10                    ; Move extruder above print 10mm
G90                             ; Absolute coordinates
G1 F5000 X0 Y0                  ; Move extruder to 0,0 in XY
M84                             ; Disable motors"""

def set_printer(n):
    if n == 0:
        return "3Dpotter Super"
    elif n == 1:
        return "3Dpotter Micro"
    elif n == 2:
        return "Eazao"
    elif n == 3:
        return "Lutum"
        
def set_x_y_shift(n):
    if n == 0:
        return [202.5, 202.5]
    elif n == 1:
        return [132.0, 132.0]
    elif n == 2:
        return [75, 75]
    elif n == 3:
        return [132.0, 132.0]

def print_resolution(res):
    return float(res)
    
def curves_lengths(curves):
    lengths=[]
    for c in curves:
        lengths.append(rs.CurveLength(c))
    return lengths


out_file = open(file, 'w+');  
rate = printer_info[3]
#lengths = curves_lengths(c)
#res = print_resolution(1.0)
printer = set_printer(printer_info[0])
initial_comments = set_initial_comments(printer, printer_info[1], printer_info[2], printer_info[3], printer_info[4])
printing_comments = set_printing_comments(printing_info[0],printing_info[1],printing_info[2],printing_info[3],printing_info[4],printing_info[5],printing_info[6])
preamble = set_preamble(printer_info[0])
x_y_shift = set_x_y_shift(printer_info[0])


#div=[]
#for l in lengths:
#        div.append(round(l/res))

#points=[]
#for i in range(len(c)):
#    point=rs.DivideCurve(c[i],div[i])
#    for p in point:
#        points.append(p)
#    i=i+1


extrusion_rates=[]
n=1
while n<len(points):
    dis=rs.Distance(points[n-1],points[n])
    ext=rate*dis
    extrusion_rates.append(ext)
    n=n+1
extrusion_rates.append(extrusion_rates[len(points)-2])



i=0
gcode_body = ""
for p in points:
    x=round(p.X,4)
    y=round(p.Y,4)
    z=round(p.Z,4)
    gcode_body = gcode_body + str("G1 X" + str(x+x_y_shift[0]) + " Y" + str(y+x_y_shift[1]) + " Z" + str(z) + " E" + str(round(extrusion_rates[i],4))+"\n")
    #print("G1 X" + str(p.X) + " Y" + str(p.Y) + " Z" + str(p.Z) + " E" + str(extrusion_rates[i]))
    i=i+1
    
gcode = initial_comments + printing_comments + preamble+ gcode_body + set_postamble()


out_file.write(gcode)
out_file.close()
# ---------- end python_3 ----------

# ---- group: Tool Path Viz (continued)
lng_4 = ListLength(List=pt_3)
dom = ConstructDomain(DomainStart="0", DomainEnd=lng_4)
remap = RemapNumbers(Value=percentage_to_visualize, Source=Domain(0, 1), Target=dom)  # -> Mapped, Clipped
dom_2 = ConstructDomain(DomainStart=0, DomainEnd=remap.Mapped)
subset = SubList(List=pt_3, Domain=dom_2, Wrap=Toggle(False))  # -> List, Index
pline = PolyLine(Vertices=subset.List, Closed=False)

# ==== cluster Cluster
T = ClusterInput()
tstat = TreeStatistics(Tree=T)  # -> Paths, Length, Count
lng = ListLength(List=tstat.Paths)
L = ClusterOutput(lng)

# ==== cluster FlipClosedCurvesSame
relay = ClusterInput()
explode = Explode(Curve=relay, Recursive=True)  # -> Segments, Vertices
item = ListItem(List=explode.Segments, Index=0, Wrap=True)
midpt = CurveMiddle(Curve=item)  # -> simplify(Midpoint)
crv_cp = CurveClosestPoint(Point=midpt, Curve=relay)  # -> Point, Parameter, Distance
eval = EvaluateCurve(Curve=relay, Parameter=crv_cp.Parameter)  # -> Point, Tangent, Angle
Z = UnitZ(Factor=1)
vrot = Rotate(Vector=eval.Tangent, Axis=Z, Angle="Pi/2")
move = Move(Geometry=eval.Point, Motion=vrot)  # -> Geometry, Transform
incurve = PointInCurve(Point=move.Geometry, Curve=relay)  # -> simplify(Relationship), Point
expression = Expression(x=incurve.Relationship, Expression="If(x=0,0,1)")
dispatch = Dispatch(List=relay, DispatchPattern=expression)  # -> ListA, ListB
flip = FlipCurve(Curve=dispatch.ListB)  # -> Curve, Flag
weave = Weave(Pattern=expression, Stream0=flip.Curve, Stream1=dispatch.ListA, NullGaps=False)
W = ClusterOutput(weave)

# ==== cluster MaxInList
N = ClusterInput()
bnd = Bounds(Numbers=N)
dedomain = DeconstructDomain(Domain=bnd)  # -> Start, End
E = ClusterOutput(dedomain.End)
